# Grasshopper definition example.gh (Grasshopper 1.0.7)
# plug-ins: Kangaroo2 Components, MeshQuadrangulation, Weaverbird

conmesh = ConstructMesh(Vertices=[Point(0, 0, 0), Point(10, 0, 0), Point(10, 10, 0), Point(0, 10, 0)], Faces={A=0, B=1, C=2, D=3})
triremesh = TriRemesh(Geometry=conmesh, Length=Slider(1.29, range=0..3), Iterations=25)  # -> Triangulation, Dual, Creases
m_quadr = MeshQuadrangulation(Mesh=triremesh.Triangulation, Sources=Slider(52, range=0..100))
nv = NakedVertices(Mesh=m_quadr)  # -> ClothedIndex, NakedIndex, ClothedPts, NakedPts
pt = Point(flatten(nv.NakedPts))
demesh = DeconstructMesh(Mesh=conmesh)  # -> Vertices, Faces, Colours, Normals
m_lpsmth = LaplacianSmooth(Mesh=m_quadr, FixedVertices=pt, Iterations=Slider(99, range=1..100))
catmull = CatmullClark(Mesh=m_quadr, FixedVertices=demesh.Vertices)
wbcatmullclark = WeaverbirdsCatmullClarkSubdivision(MeshCurves=m_lpsmth, Level=1, SmoothNakedEdges=0)
mesh = Mesh(m_quadr)
demesh_2 = DeconstructMesh(Mesh=catmull)  # -> Vertices, Faces, Colours, Normals
medges = MeshEdges(Mesh=mesh)  # -> NakedEdges, InteriorEdges, NonManifoldEdges
preview = CustomPreview(Geometry=mesh, Material=ColourSwatch(SwatchColor=RGB(214, 214, 214)))
